# Grasshopper definition experiments.gh (Grasshopper 1.0.7)

source_dont_delet_this = Curve([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])
python = GhPythonScript()  # -> out, a
# ---------- python: Python ----------
import csv
import Grasshopper as gh

csvReader =  csv.reader(open('/Users/jyou/Desktop/Fungal_Signal_Visualization/pico2tsv/example_2.csv','r'), delimiter=',')
data = []
i = -1
for row in csvReader:
    i+=1
    if(i>=2):
        data.append(row[2])

windows = []
for j in range(0,180,1):
    c = len(data) - j -1
    windows.append(data[c])
a = windows
# ---------- end python ----------
graph = QuickGraph(python.a, SortOrder=0)
