# Grasshopper definition waveLight.gh (Grasshopper 1.0.7)
# plug-ins: Human

source_dont_delet_this = Curve([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])
crv = Curve(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)
source_dont_delet_this_2 = Curve([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])
pt = Point([Point(23.40413048, 6.875983798, 0), Point(12.28179494, -21.17553475, 0), Point(3.07550959, -9.799886888, 0), Point(-16.67435215, 1.841952695, 0), Point(-13.74880503, -23.56674854, 0), Point(-2.938766355, 13.33177243, 0)])
bbox = BoundingBox(Content=crv, Plane=PlaneXY(0, 0, 0))  # -> Box, Box_2
python = GhPythonScript()  # -> out, labels, numbers
# ---------- python: Python ----------
import csv
import ghpythonlib.treehelpers as th
import Rhino as rh
import Grasshopper as gh

labels = []
csvReader =  csv.reader(open('/Users/jyou/Downloads/Experiments Electrical Recordings/Lab02 231219/Book1.csv','r'), delimiter=',')

dt = gh.DataTree[object]() # grasshopper dataTree 
list_counter = 0
for row in csvReader:
    if list_counter == 0:
        labels = row[0].split(',')
        list_counter+=1
    else:
        raw = row[0].split(',')
        list = []
        for txt in raw:
            list.append(txt.replace('"',''))
        dt.AddRange(list, gh.Kernel.Data.GH_Path(list_counter))
        list_counter+=1

numbers = dt
# ---------- end python ----------
voronoi = Voronoi(Points=pt, Boundary=bbox.Box, BruteForceOverride=False)
midpt = CurveMiddle(Curve=source_dont_delet_this)
item = ListItem(List=python.numbers, Index=Slider(4, range=1..8), Wrap=True)  # -> flatten(Item)
lng = ListLength(List=pt)
trigger = Trigger(Interval=100, TimerInterval=100, Target=python_2)
midpt_2 = CurveMiddle(Curve=source_dont_delet_this_2)
pt_2 = Point(Point(23.56842432, 18.2958564, 0))
cp = ClosestPoint(Point=midpt, Cloud=pt)  # -> ClosestPoint, CPIndex, Distance
series = Series(Start=0, Step=1, Count=lng)
txt = Text(cp.CPIndex)
txt_2 = Text(series)
dist = Distance(PointA=pt_2, PointB=midpt_2)
python_2 = GhPythonScript(x=item, start=Button(), y="8")  # -> out, reverse(a); inputs x: list, start: Boolean, y: Int32
# ---------- python_2: Python ----------
maximum = max(x)
minimum = min(x)

def remap(number, newRange, newMin):
    return ((number-minimum)*newRange)/ (maximum -minimum) + newMin

if start:
    timer = 0
else:
    timer+=1
    timer = timer%(len(x)-1)

graph = []

if timer < len(x)-y:
    for i in range(timer, timer+15, 1):
        graph.append(remap(x[i], 1, 0))
a = graph
# ---------- end python_2 ----------
gradient = Gradient(
    LowerLimit=0,
    UpperLimit=lng,
    Parameter=series,
    stops=[0.0811: RGB(227, 91, 104), 0.507: RGB(227, 159, 41), 0.907: RGB(0, 229, 255)])
bnd = Bounds(Numbers=dist)
mindex = MemberIndex(Set=txt, Member=txt_2)  # -> Index, Count
dedomain = DeconstructDomain(Domain=bnd)  # -> Start, End
item_2 = ListItem(List=cp.Distance, Index=mindex.Index, Wrap=True)
div = DivideDomain(Domain=dedomain.End, Count="8")
reldif = RelativeDifferences(Values=python_2.a)
number_slider = Slider(7, range=0..10)
bnd_2 = Bounds(Numbers=item_2)
subtraction = Subtraction(A=dedomain.End, B=Slider(0, range=0..30))
neg = Negative(Value="-0.01")
item_3 = ListItem(List=source_dont_delet_this, Index=mindex.Index, Wrap=True)
ahsl = SplitAHSL(Colour=graft(gradient))  # -> Alpha, Hue, Saturation, Luminance
fdom = FindDomain(Domains=div, Number=dist, Strict=False)  # -> Index, Neighbour
remap = RemapNumbers(Value=item_2, Source=bnd_2, Target=Domain(0, 1))  # -> Mapped, Clipped
gradient_2 = Gradient(
    LowerLimit="-0.01",
    UpperLimit=neg,
    Parameter=reldif,
    stops=[0.0811: RGB(227, 91, 104), 0.507: RGB(227, 159, 41), 0.907: RGB(0, 229, 255)])
remap_2 = RemapNumbers(Value=dist, Source=subtraction, Target=Domain(0, 1))  # -> Mapped, Clipped
subtraction_2 = Subtraction(A="1", B=remap_2.Mapped)
subtraction_3 = Subtraction(A="1", B=remap.Mapped)
hsl = ColourHSL(Alpha=ahsl.Alpha, Hue=ahsl.Hue, Saturation=subtraction_3, Luminance=ahsl.Luminance)
item_4 = ListItem(List=gradient_2, Index=fdom.Index, Wrap=True)
previewlw = CustomPreviewLineweights(Geometry=item_3, Shader=hsl, Thickness=number_slider, Absolute=False)
ahsl_2 = SplitAHSL(Colour=item_4)  # -> Alpha, Hue, Saturation, Luminance
hsl_2 = ColourHSL(Alpha=1, Hue=ahsl_2.Hue, Saturation=subtraction_2, Luminance=ahsl_2.Luminance)
panel = Panel(item_4)
previewlw_2 = CustomPreviewLineweights(Geometry=source_dont_delet_this_2, Shader=hsl_2, Thickness=number_slider, Absolute=False)
